# Grasshopper definition 0-1_checks.gh (Grasshopper 1.0.7)
# plug-ins: jSwan, PublicAPI

add_iaqcn_token_here = Panel("")
latitude = Number("51.509865")
longitude = Number("-0.118092")
get_aqicn_data = GETAQIcnData(Token=add_iaqcn_token_here, Latitude=latitude, Longitude=longitude)  # -> JSONResponse, AirQuality
get_request = GETRequest(Endpoint="https://api.teleport.org/api/cities/?search=London&limit=1")
panel = Panel(get_aqicn_data.JSONResponse)
deserialize_aqicn_data = DeserializeAQIcnData(AirQuality=get_aqicn_data.AirQuality)  # -> AirQualityIndex, Humidity, Temperature, No2, O3, Pressure, Pm10, Pm25, WindSpeed, WindDirection
deserialize_json = DeserializeJson(JSON=get_request, OutputsLocked=False)  # -> _embedded, _links, Count
deserialize_json_2 = DeserializeJson(JSON=deserialize_json._links, OutputsLocked=False)  # -> Curies, Self
panel_2 = Panel(deserialize_aqicn_data.Temperature)
panel_3 = Panel(deserialize_json_2.Self)
